# Grasshopper definition Bot.gh (Grasshopper 1.0.4)

timer = Timer(TimerInterval=1000, Target=bool)
bool = Boolean([True, False])
path = FilePath("C:\Users\Sjaak\Documents\GitHub\TwitchBot\Output.txt")
python = GhPythonScript(x=path, y=bool)  # -> flatten(out), a
# ---------- python: Python ----------
__author__ = "Sjaak"
__version__ = "2018.03.10"

import rhinoscriptsyntax as rs
if y == True:
    f = open(x, "r")
    lines = f.readlines()
    f.close
    for line in lines:
        print line
else: pass
# ---------- end python ----------
panel = Panel(python.out)
cull = CullPattern(List=python.out, CullPattern=[True, False])
panel_2 = Panel(cull)

lng = ListLength(List=cull)
subtraction = Subtraction(A=lng, B=Slider(1, range=0..1))
subtraction_2 = Subtraction(A=subtraction, B=Slider(10, range=0..100))
panel_3 = Panel("Chat")
dom = ConstructDomain(DomainStart=subtraction_2, DomainEnd=subtraction)
panel_4 = Panel("""2,22,0
2,20,0
2,18,0
2,16,0
2,14,0
2,12,0
2,10,0
2,8,0
2,6,0
2,4,0
2,2,0""")
subset = SubList(List=cull, Domain=dom, Wrap=True)  # -> flatten(List), Index
pt = Point(panel_4)
tag = TextTag3D(Location=pt, Text=subset.List, Size=1, Justification=7)

item = ListItem(List=cull, Index=Slider(19, range=0..100), Wrap=True)
# Make a house with
# !house, door, windows
python_2 = GhPythonScript(x=item)  # -> houseStatus, doorStatus, windowStatus
# ---------- python_2: Python ----------
"""Twitch.tv./Ridgure"""

__author__ = "Ridgure"
__version__ = "2018.03.19"

import rhinoscriptsyntax as rs
words = x.split(" ")
wordsLowercase = x.lower().split(" ")
if "house" not in globals():
    house = False
if "door" not in globals():
    door = False
if "window" not in globals():
    window = False
try:
    if "!house" in wordsLowercase[1]:
        house = True
        houseStatus = house
    if "door" in wordsLowercase[1]:
        door = True
        doorStatus = door
    if "windows" in wordsLowercase[1]:
        window = True
        windowStatus = window
    if "!demolish" in wordsLowercase[1]:
        house = False
        door = False
        window = False
        houseStatus = house
        doorStatus = door
        windowStatus = window
    else:
        pass
except Exception, e:
    print e
    pass
houseStatus = house
doorStatus = door
windowStatus = window
# ---------- end python_2 ----------
brep = Brep(<brep referenced from the Rhino model>)
brep_2 = Brep(<brep referenced from the Rhino model>)
brep_3 = Brep([<brep referenced from the Rhino model> x3])
dispatch = Dispatch(List=brep, DispatchPattern=python_2.houseStatus)  # -> ListA, ListB
dispatch_2 = Dispatch(List=brep_2, DispatchPattern=python_2.doorStatus)  # -> ListA, ListB
dispatch_3 = Dispatch(List=brep_3, DispatchPattern=python_2.windowStatus)  # -> ListA, ListB
merge = Merge(Data1=dispatch.ListA, Data2=dispatch_2.ListA, Data3=dispatch_3.ListA)
debrep = DeconstructBrep(Brep=merge)  # -> Faces, Edges, Vertices
move = Move(Geometry=debrep.Faces, Motion="20,0,0")  # -> Geometry, Transform
brep_4 = Brep(move.Geometry)
